# Grasshopper definition BladeDesign.gh (Grasshopper 1.0.7)
# plug-ins: Pufferfish

num_of_section_crvs = Slider(7, range=0..60)
margin_from_center = Slider(7, range=0..10)
dist_b_section_crvs = Slider(15, range=0..60)
num_of_blades = Slider(2, range=0..10)
blade_rotation = Slider(24, range=0..180)
scale_x_mult = Slider(0.798, range=0..3)
scale_y_mult = Slider(1.812, range=0..3)
cylinder_length = Slider(7, range=0..10)
cylinder_radius = Slider(11, range=0..100)
shaft_radius = Slider(3, range=0..100)
crv = Curve(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)
series = Series(Start=margin_from_center, Step=dist_b_section_crvs, Count=num_of_section_crvs)
brec = BoundingRectangle(Geometry=crv, Plane=PlaneXY(0, 0, 0), Axis=0, Slide=0, Union=True)  # -> Bounding, DimensionX, DimensionY
Z = UnitZ(Factor=series)
move = Move(Geometry=crv, Motion=Z)  # -> Geometry, Transform
ccx = CurveCurve(CurveA=brec.Bounding, CurveB=crv)  # -> Points, ParamsA, ParamsB
x_minus_one = XMinusOne(NumberX=num_of_section_crvs)
pt = Point(ccx.Points)
range = Range(Domain=Domain(0, 1), Steps=x_minus_one)
item = ListItem(List=pt, Index=Slider(3, range=0..10), Wrap=True)
graph = GraphMapper(
    range,
    x0=0,
    x1=1,
    y0=0,
    y1=1,
    container_name="Bezier",
    cpx=[0, 0.3247291446, 0.2992401123, 1],
    cpy=[0.4521740675, 0.7974088192, 0.496000886, 0.2160847783])
graph_2 = GraphMapper(range, x0=0, x1=1, y0=0, y1=1, Cx=0.3408517241, Cy=0.4618114233, container_name="Conic")
graph_3 = GraphMapper(
    range,
    x0=0,
    x1=1,
    y0=0,
    y1=1,
    container_name="Bezier",
    cpx=[0, 0.3446969688, 0.7980304956, 1],
    cpy=[0.3837236762, 1, 0.6021606326, 0.1312971115])
multiplication = Multiplication(A=graph, B=scale_x_mult)
multiplication_2 = Multiplication(A=graph_3, B=scale_y_mult)
scale_nu = ScaleNU(Geometry=move.Geometry, Plane=item, ScaleX=multiplication, ScaleY=multiplication_2, ScaleZ=1)  # -> Geometry, Transform
dom = ConstructDomain(DomainStart=0, DomainEnd=blade_rotation)
remap = RemapNumbers(Value=graph_2, Source=Domain(0, 1), Target=dom)  # -> Mapped, Clipped
rotate = Rotate(Geometry=scale_nu.Geometry, Angle=degrees(remap.Mapped), Plane=PlaneXY(0, 0, 0))  # -> Geometry, Transform
item_2 = ListItem(List=scale_nu.Geometry, Index=0, Wrap=True)
neg = Negative(Value=cylinder_length)
loft = Loft(Curves=rotate.Geometry, Options={Adjust=False, Closed=False, LoftEnds=0, LoftSimp=0, LoftType=0, Rebuild=10, Refit=0.01})
area = Area(Geometry=item_2)  # -> Area, Centroid
xz = XZPlane(Origin=area.Centroid)
cyl = Cylinder(Base=xz, Radius=shaft_radius, Length=expr("x*2", [neg, cylinder_length]))
cyl_2 = Cylinder(Base=xz, Radius=cylinder_radius, Length=[cylinder_length, neg])
cap = CapHoles(Brep=loft)
join = BrepJoin(Breps=cyl)  # -> Breps, Closed
join_2 = BrepJoin(Breps=cyl_2)  # -> Breps, Closed
arrpolar = PolarArray(Geometry=cap, Plane=xz, Count=num_of_blades, Angle=6.283185307)  # -> Geometry, Transform
cap_2 = CapHoles(Brep=join.Breps)
cap_3 = CapHoles(Brep=join_2.Breps)
sunion = SolidUnion(Breps=flatten([arrpolar.Geometry, cap_3]))
sdiff = SolidDifference(BrepsA=sunion, BrepsB=cap_2)
preview = CustomPreview(
    Geometry=sdiff,
    Material={diffuse=RGB(221, 160, 221), emission=RGB(66, 48, 66), shine=0.5, specular=RGB(255, 255, 255), transparency=0})
